# Grasshopper definition Cuttlefish-Examples.gh (Grasshopper 1.0.8)
# plug-ins: Cuttlefish, Cordyceps

# ---- group: Start: rectangle and grid
# Cuttlefish examples. The tree starts on the left from one rectangle and one grid; each example on the right is moved into its own 100 x 100 square in Rhino (5 per row).
panel = Panel("{0,0,0}")
number_slider = Slider(100, range=10..200)
rectangle = Rectangle(Plane=panel, XSize=number_slider, YSize=number_slider, Radius=0)  # -> Rectangle, Length
number_slider_2 = Slider(10, range=2..30)
grid = CreateGrid(Rectangle=rectangle.Rectangle, CellMaxSizeX=number_slider_2, CellMaxSizeY=number_slider_2)

# ---- group: Attractor circle
cir = Circle(Plane="{50,50,0}", Radius=Slider(22, range=1..50))

# ---- group: Circular grid
cir_2 = Circle(Plane="{50,50,0}", Radius=Slider(48, range=1..50))
cirgrid = CircularGrid(Circle=cir_2, DensityByCircle=10, DensityOfCircle=10)

# ---- group: Blurred grid
number_slider_3 = Slider(8, range=0..20)
blr = Blur(Points=grid, BlurX=number_slider_3, BlurY=number_slider_3, BlurZ=0, Seed=Slider(18, range=0..100))

# ---- group: Cells
voro = Voronoi(Rectangle=rectangle.Rectangle, Points=blr)

# ---- group: Attractor
atrk = Attractor(Points=grid, Curve=cir, AttractionFactor=Slider(0.8, range=0..1), AttractionDistance=Slider(25, range=0..60))
move = Move(Geometry=atrk, Motion="{0,0,0}")  # -> Geometry, Transform

# ---- group: Contour
cont = Contour(Points=grid, Attractors=cir, Levels=10)
move_2 = Move(Geometry=cont, Motion="{140,0,0}")  # -> Geometry, Transform

# ---- group: Flow
flow = Flow(Seeds=flatten(grid), Guides=cir, Step=1, Count=50, Rectangle=rectangle.Rectangle)
move_3 = Move(Geometry=flow, Motion="{280,0,0}")  # -> Geometry, Transform

# ---- group: Weave
line = Lining(Points=grid, LineType=True, Rectangle=rectangle.Rectangle)
cont_2 = Contour(Points=grid, Attractors=cir, Levels=10)
weave = Weave(CurvesA=line, CurvesB=flatten(cont_2), Gap=1)
move_4 = Move(Geometry=weave, Motion="{420,0,0}")  # -> Geometry, Transform

# ---- group: Lining
line_2 = Lining(Points=grid, LineType=True, Rectangle=rectangle.Rectangle)
move_5 = Move(Geometry=line_2, Motion="{560,0,0}")  # -> Geometry, Transform

# ---- group: Meshing
net = Meshing(Points=grid, LineType=True, Rectangle=rectangle.Rectangle)
move_6 = Move(Geometry=net, Motion="{0,-140,0}")  # -> Geometry, Transform

# ---- group: CreateGrid
move_7 = Move(Geometry=grid, Motion="{140,-140,0}")  # -> Geometry, Transform

# ---- group: Blur
number_slider_4 = Slider(2, range=0..10)
blr_2 = Blur(Points=grid, BlurX=number_slider_4, BlurY=number_slider_4, BlurZ=0, Seed=0)
move_8 = Move(Geometry=blr_2, Motion="{280,-140,0}")  # -> Geometry, Transform

# ---- group: Truchet
truch = Truchet(Points=grid, Type=0, Seed=0)
move_9 = Move(Geometry=truch, Motion="{420,-140,0}")  # -> Geometry, Transform

# ---- group: Maze
maze = Maze(Points=grid, Seed=0)
move_10 = Move(Geometry=maze, Motion="{560,-140,0}")  # -> Geometry, Transform

# ---- group: Wander
wand = Wander(Points=grid, Radius=Slider(2, range=0..5), Seed=0)
move_11 = Move(Geometry=wand, Motion="{0,-280,0}")  # -> Geometry, Transform

# ---- group: Dune
dune = Dune(Points=grid, Radius=Slider(2, range=0..5))
move_12 = Move(Geometry=dune, Motion="{140,-280,0}")  # -> Geometry, Transform

# ---- group: Delaunay
dela = Delaunay(Points=blr)
move_13 = Move(Geometry=dela, Motion="{280,-280,0}")  # -> Geometry, Transform

# ---- group: Bubble
bubl = Bubble(Points=blr, Factor=1)
move_14 = Move(Geometry=bubl, Motion="{420,-280,0}")  # -> Geometry, Transform

# ---- group: Voronoi
move_15 = Move(Geometry=voro, Motion="{560,-280,0}")  # -> Geometry, Transform

# ---- group: Pebble
pebl = Pebble(Cells=voro, Offset=1, Radius=2)
move_16 = Move(Geometry=pebl, Motion="{0,-420,0}")  # -> Geometry, Transform

# ---- group: Hatch
hatch = Hatch(Cells=voro, Spacing=2, Seed=0)
move_17 = Move(Geometry=hatch, Motion="{140,-420,0}")  # -> Geometry, Transform

# ---- group: Worm
line_3 = LineSDL(Start="{0,0,0}", Direction=Vector(0, 0, 1), Length=Slider(2, range=0.5..10))
crv = Curve(line_3)
worm = Worm(Cells=voro, Head=crv, Seed=0)
move_18 = Move(Geometry=worm, Motion="{280,-420,0}")  # -> Geometry, Transform

# ---- group: CircularGrid
move_19 = Move(Geometry=cirgrid, Motion="{420,-420,0}")  # -> Geometry, Transform

# ---- group: Spiral
spir = Spiral(Points=cirgrid)
move_20 = Move(Geometry=spir, Motion="{560,-420,0}")  # -> Geometry, Transform

# ----
cordyceps = Cordyceps(HttpPort=26929, DebugLevel=0)  # -> About, Status, LastCommand
